# Dynamo graph InsertIntoSqlite.dyn (Dynamo 1.3.0.875)

file_path = Filename("..\..\..\..\..\..\Dev Lab\SeaDUG\Sandbox\SQLite Example\DB\Mechanical.db")
boolean = BoolSelector(true)
table_name = StringInput("MechDucts")
string = StringInput("Height")
string_2 = StringInput("Width")
column_name = StringInput("Length")
create = List.Create(string, string_2, column_name)
select_model_element = DSModelElementSelection()  # 1 picked in the model
getParameterValueByName = Element.GetParameterValueByName(element=select_model_element, parameterName=string)
string_from_object = FromObject(getParameterValueByName)
getParameterValueByName_2 = Element.GetParameterValueByName(element=select_model_element, parameterName=string_2)
string_from_object_2 = FromObject(getParameterValueByName_2)
getParameterValueByName_3 = Element.GetParameterValueByName(element=select_model_element, parameterName=column_name)
string_from_object_3 = FromObject(getParameterValueByName_3)
create_2 = List.Create(string_from_object, string_from_object_2, string_from_object_3)
python_script = Python(IN[0]=table_name, IN[1]=create, IN[2]=create_2)
# ---------- python_script.python (13 lines) ----------
import clr
clr.AddReference('ProtoGeometry')
from Autodesk.DesignScript.Geometry import *
#The inputs to this node will be stored as a list in the IN variables.
tableName = IN[0]
listOfFields = IN[1]
listOfValues = IN[2]

fieldsAsString = ", ".join(listOfFields)
valuesAsString = ", ".join(listOfValues)

#Assign your output to the OUT variable.
OUT = "INSERT INTO " + tableName + " (" + fieldsAsString + ") " + "VALUES " + "(" +  valuesAsString + ");"
# ----------------------------------------
SQLite_Command = Database.Command.SQLite_Command(file_path, boolean, python_script)
watch = Watch(python_script)
